# Dynamo graph ZoomGridsArea.dyn (Dynamo 2.0.1.5055)

byCorners = BoundingBox.ByCorners()
code_block = CodeBlock { 1000; }
translate = Geometry.Translate(zTranslation=code_block)  # unwired: geometry
categories = Categories(index=231)
all_elements_of_category = ElementsOfCategory(Category=categories)
code_block_2 = CodeBlock(x=all_elements_of_category) { x; }
string = StringInput("Name")
getParameterValueByName = Element.GetParameterValueByName(element=all_elements_of_category, parameterName=string)
string_2 = StringInput("2")
code_block_3 = CodeBlock { t1 = "B"; }
string_3 = StringInput("8")
string_4 = StringInput("E")
code_block_4 = CodeBlock(A=getParameterValueByName, B=string_2, C=code_block_3, D=string_3, E=string_4) { A==B; A==C; A==D; A==E; }
filterByBoolMask = List.FilterByBoolMask(list=code_block_2, mask=code_block_4.out0)
curve = Grid.Curve(grid=filterByBoolMask.in)
filterByBoolMask_2 = List.FilterByBoolMask(list=code_block_2, mask=code_block_4.out1)
curve_2 = Grid.Curve(grid=filterByBoolMask_2.in)
intersect = Geometry.Intersect(geometry=curve, other=curve_2)
flatten = List.Flatten(list=intersect)
filterByBoolMask_3 = List.FilterByBoolMask(list=code_block_2, mask=code_block_4.out2)
curve_3 = Grid.Curve(grid=filterByBoolMask_3.in)
filterByBoolMask_4 = List.FilterByBoolMask(list=code_block_2, mask=code_block_4.out3)
curve_4 = Grid.Curve(grid=filterByBoolMask_4.in)
intersect_2 = Geometry.Intersect(geometry=curve_3, other=curve_4)
flatten_2 = List.Flatten(list=intersect_2)
list_create = List.Create(item0=flatten, item1=flatten_2)
flatten_3 = List.Flatten(list=list_create)
python_script = Python(IN[0]=flatten_3)
# ---------- python_script.python (41 lines) ----------
import clr

clr.AddReference("RevitAPI")
clr.AddReference("RevitAPIUI")
import Autodesk

clr.AddReference("RevitServices")
import RevitServices
from RevitServices.Persistence import DocumentManager
from RevitServices.Transactions import TransactionManager
from Autodesk.Revit.DB import *
from Autodesk.Revit.UI import UIView
#We need to import the Selection class from Autodesk's UI library


doc = DocumentManager.Instance.CurrentDBDocument
#Assign a short alias to the currently-open Revit document.
uiapp = DocumentManager.Instance.CurrentUIApplication
#An alias to the currently-open Revit UI application.
uidoc = uiapp.ActiveUIDocument
#An alias for the currently-open Revit UI document.


point = IN[0]

xyzList = [XYZ(p.X,p.Y,p.Z) for p in point]

t = Transaction(doc, 'Zoom to grids')
t.Start()

uiview = None
for uv in uidoc.GetOpenUIViews():
	if uv.ViewId.Equals( doc.ActiveView.Id ):
		uiview = uv
		break

uiview.ZoomAndCenterRectangle(xyzList[0],xyzList[1])

t.Commit()
#Assign your output to the OUT variable.
OUT = [uv for uv in uidoc.GetOpenUIViews()]
# ----------------------------------------
